# Grasshopper definition example_grasshopper.ghx (Grasshopper 1.0.7)

num = Number(15)
num_2 = Number(90)
circle = Circle()
hello_world = GhPythonScript(x=num, y=num_2)  # -> out, a
# ---------- hello_world: Python ----------
# Uncomment the following 2 lines to reload the code in example.py
from compas_rhino import unload_modules
unload_modules('example')

import example

example.example_method(x, y)
# ---------- end hello_world ----------
pt = Point(circle)
panel = Panel(hello_world.out)
